vi "802.11 Configure Data Source_2.gvi"   [LabVIEW Communications System Design Suite 2.0.1]
# Open UDP socket used to receive UDP packets forwarded to the target TX. This node creates a packet of pseudorandom numbers in PN mode.
# Refer also to Data source in 802.11802.11 v2.0802.11 v2.0802.11 Host.gvi.
inputs:
  "error in": error
  "receive port": u16 = 12345  # Port to use for the UDP socket connection.
  "UDP Receiver_2": UdpNetworkConnectionRefnum  # Reference to UDP socket
outputs:
  "error out": error
  "UDP Receiver out 2": UdpNetworkConnectionRefnum  # Reference to UDP socket
  "success?": bool  # Returns True if configuration succeeded and the system is ready to operate.
diagram:
  Udp Close(connection ID=$"UDP Receiver_2", error in=$"error in") -> (error out=w1)
  call "Clear Errors.gvi"(specific error code to clear=1, error in=w1) -> (error out=w2)
  Udp Open(error in=w2, net address=0, port=$"receive port", service name="", timeout ms=25000) -> (connection ID=w3, error out=w4)
  Property Node(instance in=w4) -> ("code"=w5, instance out=w6)
  case (w5) {
    frame 0, Default {
      w10 = 0xFFFF  # level SOL_SOCKET
      w11 = 1024000  # buffer size in bytes
      w12 = 0x1002  # optname SO_RCVBUF
      call "Set Socket Option.gvi"(connection in=w3, level=w10, option name=w12, value=w11, error in=w6) -> (error out=w8, connection out=w7)
      w9 = TRUE
    }
    frame 60 {
      call "Clear Errors.gvi"(specific error code to clear=w5, error in=w6) -> (error out=w8)
      w13 = "The specified port or network address is currently in use, e.g. by another instance of this VI. Select an available port or network address."
      One Button Dialog(message=w13)
      w7 = w3
      w9 = default
    }
  }
  $"UDP Receiver out 2" <- w7
  $"error out" <- w8
  $"success?" <- w9
