vi "802.11 Host Init.gvi"   [LabVIEW Communications System Design Suite 2.0.1]
# Initializes the host. The node completes the following steps to initialize:
# 	Opens, downloads, and starts the FPGA target (specific to the chosen target)
# 	Sets up all message queues
# 	Set up and starts DMA FIFOs
# 	Sets up the FPGA target (specific to chosen target)
# 	Sets the Reference Clock
# - Initializes a session cluster with the elements specified above
inputs:
  "device": string = "RIO0"  # RIO name of the target device. Default: RIO0
  "error in": error
  "reference clock": string = "Internal"  # Reference Clock source.
  "USRP bandwidth": "USRP bandwidth.gtype" = "40 MHz"  # Device bandwidth of USRP. This parameter is used to select the correct bitfile image for the USRP device. It can be ignored for FlexRIO-FAM modules.
outputs:
  "session out": "802.11 Host Session.gtype"
    # Cluster containing all references the host uses during runtime. This cluster includes the following components:
    # FPGA interface: empty reference to the FPGA handle; needs to be cast each time it is used.
    # FlexRIO session: handle to the FlexRIO device. This component is valid only with FlexRIO devices.
    # FlexRIO TX Characterization Data: This component is valid only with FlexRIO sessions.
    # FlexRIO RX Characterization Data: This component is valid only with FlexRIO sessions.
    # USRP session: handle to the USRP device, including charaterization data. This component is valid only with USRP.
    # stop queue: handle to queue used to coordinate host shutdown between the loops.
    # send queue: handle to queue used to buffer TX packets to the target.
    # receive queue: handle to queue used to buffer RX packets from the target.
    # receive throughput queue: handle to queue used to buffer information about received RX packets (time and transferred bytes).
    # UDP receiver: handle to a UPD socket used to receive payload from outside the host.
    # PN packet: byte array used to stream payload inside the host.
  "error out": error
types:
  T1 = cluster{"Timestamp": u32, "Transferred Bytes": u32}
  T2 = cluster{"fpga ref": any, "bus instance": u32, "instruction FIFO depth": u32, "executing on FPGA target": bool, "show error call chain": bool}
  T3 = cluster{"Actual Gain [dB]": f64, "Attenuation Table Index": i32}
  T4 = cluster{"Attenuation Table [dB]": f64[][], "Frequencies [Hz]": f64[], "IQ Imbalance Table": "niUsrpRio Config v1 Host.lvlib__IQ Imbalance.gtype"[], "Gain Table": T3[][]}
  "niInstr Register Bus v0 Host.lvlib__Register Bus Session.gtype" = Queue<"niInstr Register Bus v0 Host.lvlib__Session Data.gtype">
  "Semaphore RefNum.gtype" = i32
  "niUsrpRio Config v1 Host.lvlib__DB Queue Reference.gtype" = Queue<"niUsrpRio Config v1 Host.lvlib__Daughterboard Data.gtype">
  "niUsrpRio Config v1 Host.lvlib__niUsrpRio Session.gtype" = cluster{"FPGA Interface": any, "RIO Interface Number": u32, "Data Clock Rate": u32, "FPGA Data Clock Rate": u32, "Global Settings Register Bus": "niInstr Register Bus v0 Host.lvlib__Register Bus Session.gtype", "Radio 0 Settings Register Bus": "niInstr Register Bus v0 Host.lvlib__Register Bus Session.gtype", "Radio 1 Settings Register Bus": "niInstr Register Bus v0 Host.lvlib__Register Bus Session.gtype", "Radio Settings Bus Semaphore": "Semaphore RefNum.gtype", "DB Queues": "niUsrpRio Config v1 Host.lvlib__DB Queue Reference.gtype"[], "Characterization Data Valid?": bool, "EEPROM Header": "niUsrpRio Config v1 Host.lvlib__EEPROM Header.gtype", "Device Data Header": "niUsrpRio Config v1 Host.lvlib__EEPROM Device Data Header.gtype", "EEPROM Characterization Header": "niUsrpRio Config v1 Host.lvlib__EEPROM Characterization Header.gtype", "Characterization Data": "niUsrpRio Config v1 Host.lvlib__Characterization Data.gtype"[], "FPGA Current Version": u32, "FPGA Oldest Compatible Version": u32, "Fixed Logic Current Version": u32, "Fixed Logic Oldest Compatible Version": u32, "FPGA Radio Settings Bus Current Version": u32, "FPGA Radio Settings Bus Oldest Compatible Version": u32, "FPGA Board Config Current Version": u32, "FPGA Board Config Oldest Compatible Version": u32, "Daughterboard Clock Rate": u32}
  "802.11 Host Session.gtype" = cluster{"FPGA interface": "802.11 FGPA Reference.gtype", "send queue": Queue<u8[]>, "receive queue": Queue<u8[]>, "receive throughput queue": Queue<T1>, "UDP Receiver": UdpNetworkConnectionRefnum, "PN packet": u8[], "FlexRIO session": Queue<T2>, "FlexRIO TX Characterization Data": T4, "FlexRIO RX Characterization Data": T4, "USRP session": "niUsrpRio Config v1 Host.lvlib__niUsrpRio Session.gtype", "RF loop clock frequency": f64, "send queue_2": Queue<u8[]>, "send queue_3": Queue<u8[]>, "send queue_4": Queue<u8[]>, "send queue_5": Queue<u8[]>, "UDP Receiver_2": UdpNetworkConnectionRefnum, "UDP Receiver_3": UdpNetworkConnectionRefnum, "UDP Receiver_4": UdpNetworkConnectionRefnum, "UDP Receiver_5": UdpNetworkConnectionRefnum, "receive queue_2": Queue<u8[]>, "receive queue_3": Queue<u8[]>, "receive queue_4": Queue<u8[]>, "receive queue_5": Queue<u8[]>}
  "USRP bandwidth.gtype" = enum{"40 MHz", "120 MHz", "160 MHz"}
diagram:
  call "802.11 Open FPGA Target.gvi"(RIO device=$device, error in=$"error in", USRP bandwidth=$"USRP bandwidth") -> (FPGA interface=w1, error out=w2, RF loop clock frequency=w3)
  FPGA Download Node(error in=w2, reference in=w1) -> (error out=w4, reference out=w5)
  FPGA Run Node(error in=w4, reference in=w5) -> (error out=w6, reference out=w7)
  # Yue: 09/14/2017
  # 1. create 5 queues sa input
  # 2. create 5 udp receivers
  Type Cast(type="802.11 FGPA Reference.gtype" constant, x=w7) -> w8
  Property Node(instance in="802.11 Host Session.gtype" {all zero or empty}, "FPGA interface"=w8) -> (instance out=w9)
  call "802.11 Setup FPGA Target.gvi"(Reference Clock=$"reference clock", session in=w9, error in=w6) -> (session out=w10, error out=w11)
  Obtain Queue(create if not found?=TRUE, element data type=u8[] [], error in=w6, max queue size=-1) -> (error out=w12, queue out=w13)
  Obtain Queue(create if not found?=TRUE, element data type=u8[] [], error in=w6, max queue size=-1) -> (error out=w14, queue out=w15)
  Obtain Queue(create if not found?=TRUE, element data type=u8[] [], error in=w6, max queue size=-1) -> (error out=w16, queue out=w17)
  Obtain Queue(create if not found?=TRUE, element data type=u8[] [], error in=w6, max queue size=-1) -> (error out=w18, queue out=w19)
  Obtain Queue(create if not found?=TRUE, element data type=u8[] [], error in=w6, max queue size=-1) -> (error out=w20, queue out=w21)
  Obtain Queue(create if not found?=TRUE, element data type=u8[] [], error in=w6, max queue size=-1) -> (error out=w22, queue out=w23)
  Obtain Queue(create if not found?=TRUE, element data type=T1 {all zero or empty}, error in=w6, max queue size=-1) -> (error out=w24, queue out=w25)
  Obtain Queue(create if not found?=TRUE, element data type=u8[] [], error in=w6, max queue size=-1) -> (error out=w26, queue out=w27)
  Obtain Queue(create if not found?=TRUE, element data type=u8[] [], error in=w6, max queue size=-1) -> (error out=w28, queue out=w29)
  Obtain Queue(create if not found?=TRUE, element data type=u8[] [], error in=w6, max queue size=-1) -> (error out=w30, queue out=w31)
  Obtain Queue(create if not found?=TRUE, element data type=u8[] [], error in=w6, max queue size=-1) -> (error out=w32, queue out=w33)
  Property Node(instance in=w10, "send queue"=w13, "send queue_2"=w15, "send queue_3"=w17, "send queue_4"=w19, "send queue_5"=w21, "receive queue"=w23, "receive throughput queue"=w25, "RF loop clock frequency"=w3, "receive queue_2"=w27, "receive queue_3"=w29, "receive queue_4"=w31, "receive queue_5"=w33) -> (instance out=w34)  # \802\.11\ Host\ Session Properties
  $"session out" <- w34
  call "802.11 Setup DMA FIFOs.gvi"(FPGA interface=w8, error in=w6) -> (error out=w35)
  Merge Errors(w11, w35, w12, w14, w16, w18, w20, w22, w24, w26, w28, w30, w32) -> (error out=w36)
  $"error out" <- w36
