vi "802.11 Receive UDP Data_3.gvi"   [LabVIEW Communications System Design Suite 2.0.1]
# Open UDP socket used to receive UDP packets forwarded to the target TX. This node creates a packet of pseudorandom numbers in PN mode.
# Refer also to Data source in 802.11802.11 v2.0802.11 v2.0802.11 Host.gvi.
inputs:
  "UDP receiver": UdpNetworkConnectionRefnum  # Reference to the local UDP socket.
  "send queue": Queue<u8[]>  # Queue to store the packet for the target transmitter.
  "error in": error
outputs:
  "data transfer": bool  # Indicates that a UDP packet was received and queued for the transmitter.
  "error out": error
  "FIFO full": bool  # Indicates that the UDP packets were lost due to socket buffer overflow. Increase buffer size with setsocketopt (refer to 802.11commonCommon_v1_0HostSet Socket Option.gvi for more information).
diagram:
  Is Not A Number Or Path Or Refnum(number=$"UDP receiver") -> w1
  case (w1) {
    frame True {
      w2 = $"error in"
      w3 = default
      w4 = default
    }
    frame False {
      Udp Read I Pv 6 Binary(connection ID=$"UDP receiver", error in=$"error in", max size=4061, timeout ms=1) -> (data out=w5, error out=w6)
      Is Empty Array(array=w5) -> w7
      Not(x=w7) -> w3
      Enqueue Element(element=w5, error in=w6, queue=$"send queue", timeout in ms=-1) -> (error out=w8)
      call "Clear Errors.gvi"(specific error code to clear=113, error in=w8) -> (specific error cleared?=w4, error out=w9)
      call "Clear Errors.gvi"(specific error code to clear=56, error in=w9) -> (error out=w10)
      call "Clear Errors.gvi"(specific error code to clear=66, error in=w10) -> (error out=w11)
      call "Clear Errors.gvi"(specific error code to clear=1, error in=w11) -> (error out=w2)
    }
  }
  $"FIFO full" <- w4
  $"data transfer" <- w3
  $"error out" <- w2
