vi "802.11 Send UDP Data_2.gvi"   [LabVIEW Communications System Design Suite 2.0.1]
# Forwards the payload received from the target RX to a specified UDP port.
inputs:
  "target port": u16 = 12346  # UDP port to send the payload to.
  "target IP address": string = "127.0.0.1"  # IP address to send the payload to.
  "receive queue": Queue<u8[]>  # The queue the payload will be read from.
  "UDP sender": UdpNetworkConnectionRefnum  # Reference to the UDP socket used to send the payload.
  "enable": bool  # If False, the RX data is still read from the RX Data DMA FIFO, but is not forwarded to the specified UDP address/port combination.
  "error in": error
outputs:
  "FIFO full": bool  # Indicates that the socket buffer of the UDP sender was too small to receive all of the payload from the RX Data DMA FIFO, so packets were dropped. Increase the socket buffer size.
  "error out": error
  "UDP sender dup": UdpNetworkConnectionRefnum  # Reference to the UDP socket used to send the payload.
  "data transfer": bool  # Indicates that packets were successfully read from the DMA FIFO and forwarded to the UDP.
diagram:
  s1 = $"error in"  # shift register
  while {
    Dequeue Element(error in=s1, queue=$"receive queue", timeout in ms=0) -> (element=w3, error out=w4, timed out?=w5)
    Logical And($enable, not w5) -> w6
    case (w6) {
      frame False {
        w7 = w4
        w8 = FALSE
        w9 = $"UDP sender"
      }
      frame True {
        String To Ip Address(name=$"target IP address") -> (net address=w10)
        Udp Write Binary(address=w10, connection ID=$"UDP sender", data in=w3, error in=w4, port or service name=$"target port", timeout ms=10) -> (connection ID out=w9, error out=w11)
        call "Clear Errors.gvi"(specific error code to clear=1, error in=w11) -> (error out=w12)
        call "Clear Errors.gvi"(specific error code to clear=55, error in=w12) -> (specific error cleared?=w8, error out=w7)
      }
    }
    append w8 to w1
    append w6 to w2
    next s1 = w7
    stop if w5
  }
  Boolean To Integer(Boolean=w2) -> (0, 1=w13)
  Add Array Elements(numeric array=w13) -> (sum=w14)
  Is Greater Than 0(x=w14) -> w15
  $"data transfer" <- w15
  $"UDP sender dup" <- w9
  Or Array Elements(Boolean array=w1) -> (logical OR=w16)
  $"FIFO full" <- w16
  $"error out" <- s1
