vi "Manual Scheduler input.gvi"   [LabVIEW Communications System Design Suite 2.0.1]
inputs:
  "session": "802.11 Host Session.gtype"
  "Error In": error
  "Selector Selector": T5 = "Stream 1"
outputs:
  "Payload": u8[]
  "Timed Out?": bool
  "Error Out": error
types:
  T1 = cluster{"Timestamp": u32, "Transferred Bytes": u32}
  T2 = cluster{"fpga ref": any, "bus instance": u32, "instruction FIFO depth": u32, "executing on FPGA target": bool, "show error call chain": bool}
  T3 = cluster{"Actual Gain [dB]": f64, "Attenuation Table Index": i32}
  T4 = cluster{"Attenuation Table [dB]": f64[][], "Frequencies [Hz]": f64[], "IQ Imbalance Table": "niUsrpRio Config v1 Host.lvlib__IQ Imbalance.gtype"[], "Gain Table": T3[][]}
  "niInstr Register Bus v0 Host.lvlib__Register Bus Session.gtype" = Queue<"niInstr Register Bus v0 Host.lvlib__Session Data.gtype">
  "Semaphore RefNum.gtype" = i32
  "niUsrpRio Config v1 Host.lvlib__DB Queue Reference.gtype" = Queue<"niUsrpRio Config v1 Host.lvlib__Daughterboard Data.gtype">
  "niUsrpRio Config v1 Host.lvlib__niUsrpRio Session.gtype" = cluster{"FPGA Interface": any, "RIO Interface Number": u32, "Data Clock Rate": u32, "FPGA Data Clock Rate": u32, "Global Settings Register Bus": "niInstr Register Bus v0 Host.lvlib__Register Bus Session.gtype", "Radio 0 Settings Register Bus": "niInstr Register Bus v0 Host.lvlib__Register Bus Session.gtype", "Radio 1 Settings Register Bus": "niInstr Register Bus v0 Host.lvlib__Register Bus Session.gtype", "Radio Settings Bus Semaphore": "Semaphore RefNum.gtype", "DB Queues": "niUsrpRio Config v1 Host.lvlib__DB Queue Reference.gtype"[], "Characterization Data Valid?": bool, "EEPROM Header": "niUsrpRio Config v1 Host.lvlib__EEPROM Header.gtype", "Device Data Header": "niUsrpRio Config v1 Host.lvlib__EEPROM Device Data Header.gtype", "EEPROM Characterization Header": "niUsrpRio Config v1 Host.lvlib__EEPROM Characterization Header.gtype", "Characterization Data": "niUsrpRio Config v1 Host.lvlib__Characterization Data.gtype"[], "FPGA Current Version": u32, "FPGA Oldest Compatible Version": u32, "Fixed Logic Current Version": u32, "Fixed Logic Oldest Compatible Version": u32, "FPGA Radio Settings Bus Current Version": u32, "FPGA Radio Settings Bus Oldest Compatible Version": u32, "FPGA Board Config Current Version": u32, "FPGA Board Config Oldest Compatible Version": u32, "Daughterboard Clock Rate": u32}
  "802.11 Host Session.gtype" = cluster{"FPGA interface": "802.11 FGPA Reference.gtype", "send queue": Queue<u8[]>, "receive queue": Queue<u8[]>, "receive throughput queue": Queue<T1>, "UDP Receiver": UdpNetworkConnectionRefnum, "PN packet": u8[], "FlexRIO session": Queue<T2>, "FlexRIO TX Characterization Data": T4, "FlexRIO RX Characterization Data": T4, "USRP session": "niUsrpRio Config v1 Host.lvlib__niUsrpRio Session.gtype", "RF loop clock frequency": f64, "send queue_2": Queue<u8[]>, "send queue_3": Queue<u8[]>, "send queue_4": Queue<u8[]>, "send queue_5": Queue<u8[]>, "UDP Receiver_2": UdpNetworkConnectionRefnum, "UDP Receiver_3": UdpNetworkConnectionRefnum, "UDP Receiver_4": UdpNetworkConnectionRefnum, "UDP Receiver_5": UdpNetworkConnectionRefnum, "receive queue_2": Queue<u8[]>, "receive queue_3": Queue<u8[]>, "receive queue_4": Queue<u8[]>, "receive queue_5": Queue<u8[]>}
  T5 = enum{"Stream 1", "Stream 2", "Stream 3", "Stream 4", "Stream 5"}
diagram:
  Property Node(instance in=$session) -> ("send queue"=w1, "send queue_2"=w2, "send queue_3"=w3, "send queue_4"=w4, "send queue_5"=w5)
  # Yue 09/15/2017
  # 1. create a case to dequeue elements
  #  in different stream.
  w6 = "Stream 1"  # Stream ID
  Feedback Node(initial value=w6, input=$"Selector Selector") -> w7
  case (w7) {
    frame "Stream 1" {
      Dequeue Element(error in=$"Error In", queue=w1, timeout in ms=0) -> (element=w8, error out=w10, timed out?=w9)
    }
    frame "Stream 2" {
      Dequeue Element(error in=$"Error In", queue=w2, timeout in ms=0) -> (element=w8, error out=w10, timed out?=w9)
    }
    frame "Stream 3" {
      Dequeue Element(error in=$"Error In", queue=w3, timeout in ms=0) -> (element=w8, error out=w10, timed out?=w9)
    }
    frame "Stream 4" {
      Dequeue Element(error in=$"Error In", queue=w4, timeout in ms=0) -> (element=w8, error out=w10, timed out?=w9)
    }
    frame "Stream 5" {
      Dequeue Element(error in=$"Error In", queue=w5, timeout in ms=0) -> (element=w8, error out=w10, timed out?=w9)
    }
  }
  $Payload <- w8
  $"Timed Out?" <- w9
  $"Error Out" <- w10
