vi "Manual Scheduler output.gvi"   [LabVIEW Communications System Design Suite 2.0.1]
inputs:
  "FPGA interface": "802.11 FGPA Reference.gtype"  # Interface to the device's FPGA handle.
  "session": "802.11 Host Session.gtype"
  "receive throughput queue": Queue<T2>  # Queue to store statistical information about the payload (time stamp and size).
  "Station Active": bool
  "error in": error
  "Output Selector": T1 = "Stream 1"
outputs:
  "decoded": bool  # Indicates that an ICP packet was successfully decoded.
  "error out": error
types:
  T1 = enum{"Stream 1", "Stream 2", "Stream 3", "Stream 4", "Stream 5"}
  T2 = cluster{"Timestamp": u32, "Transferred Bytes": u32}
  T3 = cluster{"fpga ref": any, "bus instance": u32, "instruction FIFO depth": u32, "executing on FPGA target": bool, "show error call chain": bool}
  T4 = cluster{"Actual Gain [dB]": f64, "Attenuation Table Index": i32}
  T5 = cluster{"Attenuation Table [dB]": f64[][], "Frequencies [Hz]": f64[], "IQ Imbalance Table": "niUsrpRio Config v1 Host.lvlib__IQ Imbalance.gtype"[], "Gain Table": T4[][]}
  "niInstr Register Bus v0 Host.lvlib__Register Bus Session.gtype" = Queue<"niInstr Register Bus v0 Host.lvlib__Session Data.gtype">
  "Semaphore RefNum.gtype" = i32
  "niUsrpRio Config v1 Host.lvlib__DB Queue Reference.gtype" = Queue<"niUsrpRio Config v1 Host.lvlib__Daughterboard Data.gtype">
  "niUsrpRio Config v1 Host.lvlib__niUsrpRio Session.gtype" = cluster{"FPGA Interface": any, "RIO Interface Number": u32, "Data Clock Rate": u32, "FPGA Data Clock Rate": u32, "Global Settings Register Bus": "niInstr Register Bus v0 Host.lvlib__Register Bus Session.gtype", "Radio 0 Settings Register Bus": "niInstr Register Bus v0 Host.lvlib__Register Bus Session.gtype", "Radio 1 Settings Register Bus": "niInstr Register Bus v0 Host.lvlib__Register Bus Session.gtype", "Radio Settings Bus Semaphore": "Semaphore RefNum.gtype", "DB Queues": "niUsrpRio Config v1 Host.lvlib__DB Queue Reference.gtype"[], "Characterization Data Valid?": bool, "EEPROM Header": "niUsrpRio Config v1 Host.lvlib__EEPROM Header.gtype", "Device Data Header": "niUsrpRio Config v1 Host.lvlib__EEPROM Device Data Header.gtype", "EEPROM Characterization Header": "niUsrpRio Config v1 Host.lvlib__EEPROM Characterization Header.gtype", "Characterization Data": "niUsrpRio Config v1 Host.lvlib__Characterization Data.gtype"[], "FPGA Current Version": u32, "FPGA Oldest Compatible Version": u32, "Fixed Logic Current Version": u32, "Fixed Logic Oldest Compatible Version": u32, "FPGA Radio Settings Bus Current Version": u32, "FPGA Radio Settings Bus Oldest Compatible Version": u32, "FPGA Board Config Current Version": u32, "FPGA Board Config Oldest Compatible Version": u32, "Daughterboard Clock Rate": u32}
  "802.11 Host Session.gtype" = cluster{"FPGA interface": "802.11 FGPA Reference.gtype", "send queue": Queue<u8[]>, "receive queue": Queue<u8[]>, "receive throughput queue": Queue<T2>, "UDP Receiver": UdpNetworkConnectionRefnum, "PN packet": u8[], "FlexRIO session": Queue<T3>, "FlexRIO TX Characterization Data": T5, "FlexRIO RX Characterization Data": T5, "USRP session": "niUsrpRio Config v1 Host.lvlib__niUsrpRio Session.gtype", "RF loop clock frequency": f64, "send queue_2": Queue<u8[]>, "send queue_3": Queue<u8[]>, "send queue_4": Queue<u8[]>, "send queue_5": Queue<u8[]>, "UDP Receiver_2": UdpNetworkConnectionRefnum, "UDP Receiver_3": UdpNetworkConnectionRefnum, "UDP Receiver_4": UdpNetworkConnectionRefnum, "UDP Receiver_5": UdpNetworkConnectionRefnum, "receive queue_2": Queue<u8[]>, "receive queue_3": Queue<u8[]>, "receive queue_4": Queue<u8[]>, "receive queue_5": Queue<u8[]>}
diagram:
  Property Node(instance in=$session) -> ("receive queue"=w1, "receive queue_2"=w2, "receive queue_3"=w3, "receive queue_4"=w4, "receive queue_5"=w5)
  w6 = "Stream 1"  # Stream ID
  Feedback Node(initial value=w6, input=$"Output Selector") -> w7
  case (w7) {
    frame "Stream 1", Default {
      call "802.11 Receive RX ICP.gvi"(FPGA interface=$"FPGA interface", error in=$"error in", receive queue=w1, receive throughput queue=$"receive throughput queue", enqueue decoded data=$"Station Active") -> (error out=w9, decoded=w8)
    }
    frame "Stream 2" {
      call "802.11 Receive RX ICP_2.gvi"(FPGA interface=$"FPGA interface", error in=$"error in", receive queue=w2, receive throughput queue=$"receive throughput queue", enqueue decoded data=$"Station Active") -> (error out=w9, decoded=w8)
    }
    frame "Stream 3" {
      call "802.11 Receive RX ICP_3.gvi"(FPGA interface=$"FPGA interface", error in=$"error in", receive queue=w3, receive throughput queue=$"receive throughput queue", enqueue decoded data=$"Station Active") -> (error out=w9, decoded=w8)
    }
    frame "Stream 4" {
      call "802.11 Receive RX ICP_4.gvi"(FPGA interface=$"FPGA interface", error in=$"error in", receive queue=w4, receive throughput queue=$"receive throughput queue", enqueue decoded data=$"Station Active") -> (error out=w9, decoded=w8)
    }
    frame "Stream 5" {
      call "802.11 Receive RX ICP_5.gvi"(FPGA interface=$"FPGA interface", error in=$"error in", receive queue=w5, receive throughput queue=$"receive throughput queue", enqueue decoded data=$"Station Active") -> (error out=w9, decoded=w8)
    }
  }
  $decoded <- w8
  $"error out" <- w9
